# Grasshopper definition Sample.gh (Grasshopper 1.0.7)

# ----
# Infraset_assembly (Classic rail track-Australia)
number_slider = Slider(60, range=0..100)
list = ValueList({"One": 1, "Two": 2, "Three": 2² - 1, "Four": Sqrt(16), "Pedestrian_Way_Concrete", "Railway_Track_Classical_1km_150m3", "Bell_Moreland_Viaduct_Segment", "Retaining_Wall_L_Shaped", "OHLE_Mast_Foundation_Assembly", "Abutment_50MPa", "Drainage_Trench_RCP", "Urban_Street_Asphalt", "Demolish_Redundant_Footing", "MorelandStation_Structure_520m3_No", "BE_Double_Track_Classical_Ballast", "Pedestrian_Path_Concrete", "BE_Single_Track_Asphalt_Bedding", "Noise_Wall_NVC_Panel", "BE_Double_Track_Asphalt_Bedding", "Asphalt_Highway", "CoburgStation_Structure_1541m3_No", "CSR_Trench_Type_A", "Bicycle_path_Concrete", "Urban_Road_Flexible", "BE_Single_Track_Classical_Ballast", "Concrete_Highway"}, selected="Railway_Track_Classical_1km_150m3")
infraset_element = GhPythonScript(
    connect_button=Toggle(True),
    assembly_category=list,
    area_km_m=Slider(6.3, range=0..10),
    material_service_life=number_slider,
    PKT_million_60_years=Slider(1, range=0..1))  # -> PKT, area, port, assembly_data_list, Embodied_Energy_Coefficient__MJ_PKT, Embodied_Water_Coefficient__L_PKT, Embodied_GHG_Coefficient__kgCO₂e_PKT, Operational_Energy_coefficient_MJ_PKT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; inputs element_data_list: list, width_meter: Int32, material_service_life: Int32
# ---------- infraset_element: Python ----------
from ghpythonlib.componentbase import executingcomponent as component
from Backend_InfraSet import MaterialDatabase, AssemblyDatabase, ElementDatabase
import rhinoscriptsyntax as rs
import Rhino.Geometry as rg
import System
from Grasshopper.Kernel import GH_RuntimeMessageLevel as RML
from Grasshopper.Kernel.Special import GH_ValueList, GH_ValueListItem
from Grasshopper.Kernel import GH_Document
from System.Drawing import PointF

class InfrasetAssembly(component):
    def RunScript(
        self,
        connect_button,
        assembly_category,
        No,
        element_data_list,
        null1,
        length1,
        width,
        height,
        area_input,
        null2,
        wastage_coefficient,
        material_service_life,
        null3,
        energy_reduction_factor,
        water_reduction_factor,
        ghg_reduction_factor,
        traffic_factor,
        PKT_million_60_years_input,
    ):
        # Value list creation logic
        if connect_button and self.Params.Input[1].SourceCount == 0:
            try:
                material_db = MaterialDatabase()
                assembly_db = AssemblyDatabase(material_db.material_db)
                assembly_db.populate_assemblies()
                
                vl = GH_ValueList()
                vl.CreateAttributes()
                
                for cat in assembly_db.assembly_db.keys():
                    item = GH_ValueListItem(str(cat), "\"{0}\"".format(str(cat)))  # Legacy formatting
                    vl.ListItems.Add(item)
                
                vl.Attributes.Pivot = PointF(
                    self.Params.Input[1].Attributes.Pivot.X - 250,
                    self.Params.Input[1].Attributes.Pivot.Y
                )
                
                ghdoc = self.OnPingDocument()
                ghdoc.AddObject(vl, False)
                self.Params.Input[1].AddSource(vl)
                self.Params.OnParametersChanged()
                ghdoc.ScheduleSolution(5, GH_Document.GH_ScheduleDelegate(self.ExpireSolution))
                
            except Exception as e:
                self.AddRuntimeMessage(RML.Error, "Value list failed: {0}".format(str(e)))  # Legacy formatting

        # Original calculations (unchanged)
        element_data_list = element_data_list or []
        wastage_coefficient = wastage_coefficient or 0
        energy_reduction_factor = energy_reduction_factor or 0
        water_reduction_factor = water_reduction_factor or 0
        ghg_reduction_factor = ghg_reduction_factor or 0
        traffic_factor = traffic_factor or 1
        No = No or 1
        material_service_life = material_service_life or 60
        length1 = length1 or 1
        width = width or 1
        height = height or 1
        # Initialize material-specific accumulators
        concrete_and_plaster_products_mass = 0.0
        plastics_mass = 0.0
        glass_mass = 0.0
        insulation_mass = 0.0
        metals_mass = 0.0
        miscellaneous_mass = 0.0
        sand_stone_ceramics_mass = 0.0
        timber_mass = 0.0
        # Embodied Water by Material Categories
        Insulation_Initial_Embodied_water = 0.0
        Timber_Initial_Embodied_water = 0.0
        Glass_Initial_Embodied_water = 0.0
        Sand_stone_ceramics_Initial_Embodied_water = 0.0
        Miscellaneous_Initial_Embodied_water = 0.0
        Metals_Initial_Embodied_water = 0.0
        Plastics_Initial_Embodied_water = 0.0
        Concrete_plaster_products_Initial_Embodied_water = 0.0
        # Embodied Energy by Material Categories
        Insulation_Initial_Embodied_energy = 0.0
        Timber_Initial_Embodied_energy = 0.0
        Glass_Initial_Embodied_energy = 0.0
        Sand_stone_ceramics_Initial_Embodied_energy = 0.0
        Miscellaneous_Initial_Embodied_energy = 0.0
        Metals_Initial_Embodied_energy = 0.0
        Plastics_Initial_Embodied_energy = 0.0
        Concrete_plaster_products_Initial_Embodied_energy = 0.0
        # Embodied GHG by Material Categories
        Insulation_Initial_Embodied_GHG = 0.0
        Timber_Initial_Embodied_GHG = 0.0
        Glass_Initial_Embodied_GHG = 0.0
        Sand_stone_ceramics_Initial_Embodied_GHG = 0.0
        Miscellaneous_Initial_Embodied_GHG = 0.0
        Metals_Initial_Embodied_GHG = 0.0
        Plastics_Initial_Embodied_GHG = 0.0
        Concrete_plaster_products_Initial_Embodied_GHG = 0.0
        # Maintenance Embodied Metrics
        Insulation_Maintenance_Embodied_water = 0.0
        Timber_Maintenance_Embodied_water = 0.0
        Glass_Maintenance_Embodied_water = 0.0
        Sand_stone_ceramics_Maintenance_Embodied_water = 0.0
        Miscellaneous_Maintenance_Embodied_water = 0.0
        Metals_Maintenance_Embodied_water = 0.0
        Plastics_Maintenance_Embodied_water = 0.0
        Concrete_plaster_products_Maintenance_Embodied_water = 0.0
        Insulation_Maintenance_Embodied_energy = 0.0
        Timber_Maintenance_Embodied_energy = 0.0
        Glass_Maintenance_Embodied_energy = 0.0
        Sand_stone_ceramics_Maintenance_Embodied_energy = 0.0
        Miscellaneous_Maintenance_Embodied_energy = 0.0
        Metals_Maintenance_Embodied_energy = 0.0
        Plastics_Maintenance_Embodied_energy = 0.0
        Concrete_plaster_products_Maintenance_Embodied_energy = 0.0
        Insulation_Maintenance_Embodied_GHG = 0.0
        Timber_Maintenance_Embodied_GHG = 0.0
        Glass_Maintenance_Embodied_GHG = 0.0
        Sand_stone_ceramics_Maintenance_Embodied_GHG = 0.0
        Miscellaneous_Maintenance_Embodied_GHG = 0.0
        Metals_Maintenance_Embodied_GHG = 0.0
        Plastics_Maintenance_Embodied_GHG = 0.0
        Concrete_plaster_products_Maintenance_Embodied_GHG = 0.0



        center = surface = length2 = distance = box_height = assembly_db_result = None
        material_db = MaterialDatabase()
        assembly_db = AssemblyDatabase(material_db.material_db)
        element_db = ElementDatabase(material_db.material_db)
        assembly_db.populate_assemblies()

        assembly_data = assembly_db.assembly_db.get(assembly_category)
        if not assembly_data:
            self.AddRuntimeMessage(RML.Warning, "No data found for: {0}".format(assembly_category))
            return None

        PKT_million_60_years = (
            PKT_million_60_years_input
            if PKT_million_60_years_input is not None
            else assembly_data.get("PKT_million_60_years", 1)
        )

        if area_input is not None:
            area = area_input
        else:
            area = int(length1 * width)

        volume = area * height 

        energy_reduction_factor = min(max(energy_reduction_factor, 0), 100)
        water_reduction_factor = min(max(water_reduction_factor, 0), 100)
        ghg_reduction_factor = min(max(ghg_reduction_factor, 0), 100)
        wastage_coefficient = min(max(wastage_coefficient, 0), 100)

        embodied_energy_coefficient = embodied_water_coefficient = embodied_GHG_coefficient = 0
        maintenance_embodied_energy = maintenance_embodied_ghg = maintenance_embodied_water = maintenance_mass = 0
        pavement_mass = aluminum_mass = gravel_mass = asphalt_mass = wood_mass = upvc_mass = polycarbonate_mass = recycled_aggregate_mass = cement_mass = sand_mass = 0

        if assembly_data:
            embodied_energy_coefficient = assembly_data.get('Initial_Embodied_Energy_(MJ)', 0)
            embodied_water_coefficient = assembly_data.get('Initial_Embodied_Water_(L)', 0)
            embodied_GHG_coefficient = assembly_data.get('Initial_Embodied_GHG_(kgCO2e)', 0)

            embodied_energy_coefficient *= (1 + wastage_coefficient / 100) if embodied_energy_coefficient != 0 else 0
            embodied_water_coefficient *= (1 + wastage_coefficient / 100) if embodied_water_coefficient != 0 else 0
            embodied_GHG_coefficient *= (1 + wastage_coefficient / 100) if embodied_GHG_coefficient != 0 else 0

            embodied_energy_coefficient *= (1 - energy_reduction_factor / 100) if embodied_energy_coefficient != 0 else 0
            embodied_water_coefficient *= (1 - water_reduction_factor / 100) if embodied_water_coefficient != 0 else 0
            embodied_GHG_coefficient *= (1 - ghg_reduction_factor / 100) if embodied_GHG_coefficient != 0 else 0

            mass = assembly_data.get('Total_Mass_(kg)', 0) 
            concrete_and_plaster_products_mass = assembly_data.get('Concrete and plaster products_Mass_(kg)', 0) 
            plastics_mass = assembly_data.get('Plastics_Mass_(kg)', 0) 
            metals_mass = assembly_data.get('Metals_Mass_(kg)', 0) 
            miscellaneous_mass = assembly_data.get('Miscellaneous_Mass_(kg)', 0) 
            sand_stone_ceramics_mass = assembly_data.get('Sand, stone and ceramics_Mass_(kg)', 0) 
            timber_mass = assembly_data.get('Timber_Mass_(kg)', 0) 
            glass_mass = assembly_data.get('Glass_Mass_(kg)', 0) 
            insulation_mass = assembly_data.get('Insulation_Mass_(kg)', 0) 

            maintenance_embodied_energy = assembly_data.get('Maintenance_Embodied_Energy_(MJ)', 0) 
            maintenance_embodied_ghg = assembly_data.get('Maintenance_Embodied_GHG_(kgCO2e)', 0) 
            maintenance_embodied_water = assembly_data.get('Maintenance_Embodied_Water_(L)', 0) 
            maintenance_mass = assembly_data.get('Maintenance_Mass_(kg)', 0) 

            operational_energy_coefficient = assembly_data.get('Operational_Energy_(MJ/No)', 0) * (1 - energy_reduction_factor / 100)
            operational_ghg_coefficient = assembly_data.get('Operational_GHG_(kgCO2e/No)', 0) * (1 - ghg_reduction_factor / 100)
            operational_water_coefficient = assembly_data.get('Operational_Water_(L/No)', 0) * (1 - water_reduction_factor / 100)
            
                                # Embodied calculations GHG for material categories
            Concrete_plaster_products_Initial_Embodied_GHG = assembly_data.get("Concrete and plaster products_Initial_Embodied_GHG_(kgCO2e)", 0) * No * (material_service_life / 60)* volume
            Plastics_Initial_Embodied_GHG = assembly_data.get("Plastics_Initial_Embodied_GHG_(kgCO2e)", 0) * No * (material_service_life / 60)* volume
            Metals_Initial_Embodied_GHG = assembly_data.get("Metals_Initial_Embodied_GHG_(kgCO2e)", 0) * No * (material_service_life / 60)* volume
            Miscellaneous_Initial_Embodied_GHG = assembly_data.get("Miscellaneous_Initial_Embodied_GHG_(kgCO2e)", 0) * No * (material_service_life / 60)* volume
            Sand_stone_ceramics_Initial_Embodied_GHG = assembly_data.get("Sand, stone and ceramics_Initial_Embodied_GHG_(kgCO2e)", 0) * No * (material_service_life / 60)* volume
            Glass_Initial_Embodied_GHG = assembly_data.get("Glass_Initial_Embodied_GHG_(kgCO2e)", 0) * No * (material_service_life / 60)* volume
            Timber_Initial_Embodied_GHG = assembly_data.get("Timber_Initial_Embodied_GHG_(kgCO2e)", 0) * No * (material_service_life / 60)* volume
            Insulation_Initial_Embodied_GHG = assembly_data.get("Insulation_Initial_Embodied_GHG_(kgCO2e)", 0) * No * (material_service_life / 60)* volume
                    
                    # Maintenance Embodied GHG calculations for material categories
            Concrete_plaster_products_Maintenance_Embodied_GHG = assembly_data.get("Concrete and plaster products_Maintenance_Embodied_GHG_(kgCO2e)", 0) * No * (material_service_life / 60)* volume
            Plastics_Maintenance_Embodied_GHG = assembly_data.get("Plastics_Maintenance_Embodied_GHG_(kgCO2e)", 0) * No * (material_service_life / 60)* volume
            Metals_Maintenance_Embodied_GHG = assembly_data.get("Metals_Maintenance_Embodied_GHG_(kgCO2e)", 0) * No * (material_service_life / 60)* volume
            Miscellaneous_Maintenance_Embodied_GHG = assembly_data.get("Miscellaneous_Maintenance_Embodied_GHG_(kgCO2e)", 0) * No * (material_service_life / 60)* volume
            Sand_stone_ceramics_Maintenance_Embodied_GHG = assembly_data.get("Sand, stone and ceramics_Maintenance_Embodied_GHG_(kgCO2e)", 0) * No * (material_service_life / 60)* volume
            Glass_Maintenance_Embodied_GHG = assembly_data.get("Glass_Maintenance_Embodied_GHG_(kgCO2e)", 0) * No * (material_service_life / 60)* volume
            Timber_Maintenance_Embodied_GHG = assembly_data.get("Timber_Maintenance_Embodied_GHG_(kgCO2e)", 0) * No * (material_service_life / 60)* volume
            Insulation_Maintenance_Embodied_GHG = assembly_data.get("Insulation_Maintenance_Embodied_GHG_(kgCO2e)", 0) * No * (material_service_life / 60)* volume
                    
                    # Embodied calculations Energy for material categories
            Concrete_plaster_products_Initial_Embodied_energy = assembly_data.get("Concrete and plaster products_Initial_Embodied_energy_(MJ)", 0) * No * (material_service_life / 60)* volume
            Plastics_Initial_Embodied_energy = assembly_data.get("Plastics_Initial_Embodied_energy_(MJ)", 0) * No * (material_service_life / 60)* volume
            Metals_Initial_Embodied_energy = assembly_data.get("Metals_Initial_Embodied_energy_(MJ)", 0) * No * (material_service_life / 60)* volume
            Miscellaneous_Initial_Embodied_energy = assembly_data.get("Miscellaneous_Initial_Embodied_energy_(MJ)", 0) * No * (material_service_life / 60)* volume
            Sand_stone_ceramics_Initial_Embodied_energy = assembly_data.get("Sand, stone and ceramics_Initial_Embodied_energy_(MJ)", 0) * No * (material_service_life / 60)* volume
            Glass_Initial_Embodied_energy = assembly_data.get("Glass_Initial_Embodied_energy_(MJ)", 0) * No * (material_service_life / 60)* volume
            Timber_Initial_Embodied_energy = assembly_data.get("Timber_Initial_Embodied_energy_(MJ)", 0) * No * (material_service_life / 60)* volume
            Insulation_Initial_Embodied_energy = assembly_data.get("Insulation_Initial_Embodied_energy_(MJ)", 0) * No * (material_service_life / 60)* volume
                    
                    # Maintenance Embodied Energy calculations for material categories
            Concrete_plaster_products_Maintenance_Embodied_energy = assembly_data.get("Concrete and plaster products_Maintenance_Embodied_energy_(MJ)", 0) * No * (material_service_life / 60)* volume
            Plastics_Maintenance_Embodied_energy = assembly_data.get("Plastics_Maintenance_Embodied_energy_(MJ)", 0) * No * (material_service_life / 60)* volume
            Metals_Maintenance_Embodied_energy = assembly_data.get("Metals_Maintenance_Embodied_energy_(MJ)", 0) * No * (material_service_life / 60)* volume
            Miscellaneous_Maintenance_Embodied_energy = assembly_data.get("Miscellaneous_Maintenance_Embodied_energy_(MJ)", 0) * No * (material_service_life / 60)* volume
            Sand_stone_ceramics_Maintenance_Embodied_energy = assembly_data.get("Sand, stone and ceramics_Maintenance_Embodied_energy_(MJ)", 0) * No * (material_service_life / 60)* volume
            Glass_Maintenance_Embodied_energy = assembly_data.get("Glass_Maintenance_Embodied_energy_(MJ)", 0) * No * (material_service_life / 60)* volume
            Timber_Maintenance_Embodied_energy = assembly_data.get("Timber_Maintenance_Embodied_energy_(MJ)", 0) * No * (material_service_life / 60)* volume
            Insulation_Maintenance_Embodied_energy = assembly_data.get("Insulation_Maintenance_Embodied_energy_(MJ)", 0) * No * (material_service_life / 60)* volume
                    
                    # Embodied calculations water for material categories
            Concrete_plaster_products_Initial_Embodied_water = assembly_data.get("Concrete and plaster products_Initial_embodied_water_(L)", 0) * No * (material_service_life / 60)* volume
            Plastics_Initial_Embodied_water = assembly_data.get("Plastics_Initial_Embodied_water_(L)", 0) * No * (material_service_life / 60)* volume
            Metals_Initial_Embodied_water = assembly_data.get("Metals_Initial_Embodied_water_(L)", 0) * No * (material_service_life / 60)* volume
            Miscellaneous_Initial_Embodied_water = assembly_data.get("Miscellaneous_Initial_Embodied_water_(L)", 0) * No * (material_service_life / 60)* volume
            Sand_stone_ceramics_Initial_Embodied_water = assembly_data.get("Sand, stone and ceramics_Initial_Embodied_water_(L)", 0) * No * (material_service_life / 60)* volume
            Glass_Initial_Embodied_water = assembly_data.get("Glass_Initial_Embodied_water_(L)", 0) * No * (material_service_life / 60)* volume
            Timber_Initial_Embodied_water = assembly_data.get("Timber_Initial_Embodied_water_(L)", 0) * No * (material_service_life / 60)* volume
            Insulation_Initial_Embodied_water = assembly_data.get("Insulation_Initial_Embodied_water_(L)", 0) * No * (material_service_life / 60)* volume
                    
                    # Maintenance Embodied water calculations for material categories
            Concrete_plaster_products_Maintenance_Embodied_water = assembly_data.get("Concrete and plaster products_Maintenance_Embodied_Water_(L)", 0) * No * (material_service_life / 60)* volume
            Plastics_Maintenance_Embodied_water = assembly_data.get("Plastics_Maintenance_Embodied_Water_(L)", 0) * No * (material_service_life / 60)* volume
            Metals_Maintenance_Embodied_water = assembly_data.get("Metals_Maintenance_Embodied_Water_(L)", 0) * No * (material_service_life / 60)* volume
            Miscellaneous_Maintenance_Embodied_water = assembly_data.get("Miscellaneous_Maintenance_Embodied_Water_(L)", 0) * No * (material_service_life / 60)* volume
            Sand_stone_ceramics_Maintenance_Embodied_water = assembly_data.get("Sand, stone and ceramics_Maintenance_Embodied_Water_(L)", 0) * No * (material_service_life / 60)* volume
            Glass_Maintenance_Embodied_water = assembly_data.get("Glass_Maintenance_Embodied_Water_(L)", 0) * No * (material_service_life / 60)* volume
            Timber_Maintenance_Embodied_water = assembly_data.get("Timber_Maintenance_Embodied_Water_(L)", 0) * No * (material_service_life / 60)* volume
            Insulation_Maintenance_Embodied_water = assembly_data.get("Insulation_Maintenance_Embodied_Water_(L)", 0) * No * (material_service_life / 60)* volume

            operational_energy_coefficient *= (material_service_life / 60)
            operational_ghg_coefficient *= (material_service_life / 60)
            operational_water_coefficient *= (material_service_life / 60)

            embodied_energy_coefficient *= No * volume * (1 + wastage_coefficient / 100)
            embodied_water_coefficient *= No * volume * (1 + wastage_coefficient / 100)
            embodied_GHG_coefficient *= No * volume * (1 + wastage_coefficient / 100)
            mass *= No * volume * (1 + wastage_coefficient / 100)
            concrete_and_plaster_products_mass *= No * volume * (1 + wastage_coefficient / 100)
            plastics_mass *= No * volume * (1 + wastage_coefficient / 100)
            metals_mass *= No * volume * (1 + wastage_coefficient / 100)
            miscellaneous_mass *= No * volume * (1 + wastage_coefficient / 100)
            sand_stone_ceramics_mass *= No * volume * (1 + wastage_coefficient / 100)
            timber_mass *= No * volume * (1 + wastage_coefficient / 100)
            glass_mass *= No * volume * (1 + wastage_coefficient / 100)
            insulation_mass *= No * volume * (1 + wastage_coefficient / 100)
            operational_energy_coefficient *= No * volume
            operational_ghg_coefficient *= No * volume
            operational_water_coefficient *= No * volume 

            maintenance_embodied_energy *= No * volume * traffic_factor * (1 + wastage_coefficient / 100) * (1 - energy_reduction_factor / 100)*(material_service_life / 60)
            maintenance_embodied_ghg *= No * volume * traffic_factor * (1 + wastage_coefficient / 100) * (1 - ghg_reduction_factor / 100)*(material_service_life / 60)
            maintenance_embodied_water *= No * volume * traffic_factor * (1 + wastage_coefficient / 100) * (1 - water_reduction_factor / 100) *(material_service_life / 60)
            maintenance_mass *= No * volume * traffic_factor * (1 + wastage_coefficient / 100) * (material_service_life / 60)
            
            

        if element_data_list:
            for key, value in element_data_list:
                if key == 'maintenance_embodied_energy':
                    maintenance_embodied_energy += value
                elif key == 'maintenance_embodied_ghg':
                    maintenance_embodied_ghg += value
                elif key == 'maintenance_embodied_water':
                    maintenance_embodied_water += value
                elif key == 'maintenance_mass':
                    maintenance_mass += value
                elif key == 'pavement_mass':
                    pavement_mass += value
                elif key == 'aluminum_mass':
                    aluminum_mass += value
                elif key == 'gravel_mass':
                    gravel_mass += value
                elif key == 'asphalt_mass':
                    asphalt_mass += value
                elif key == 'wood_mass':
                    wood_mass += value
                elif key == 'upvc_mass':
                    upvc_mass += value
                elif key == 'polycarbonate_mass':
                    polycarbonate_mass += value
                elif key == 'recycled_aggregate_mass':
                    recycled_aggregate_mass += value
                elif key == 'cement_mass':
                    cement_mass += value
                elif key == 'sand_mass':
                    sand_mass += value
                elif key == 'operational_energy_coefficient':
                    operational_energy_coefficient += value
                elif key == 'operational_ghg_coefficient':
                    operational_ghg_coefficient += value
                elif key == 'operational_water_coefficient':
                    operational_water_coefficient += value
                elif key == 'embodied_energy_coefficient':
                    embodied_energy_coefficient += value
                elif key == 'embodied_water_coefficient':
                    embodied_water_coefficient += value
                elif key == 'embodied_GHG_coefficient':
                    embodied_GHG_coefficient += value
                elif key == 'mass':
                    mass += value
                elif key == 'maintenance_embodied_energy':
                    maintenance_embodied_energy += value
                elif key == 'maintenance_embodied_ghg':
                    maintenance_embodied_ghg += value
                elif key == 'maintenance_embodied_water':
                    maintenance_embodied_water += value
                elif key == 'maintenance_mass':
                    maintenance_mass += value
                # Material-Specific Mass
                elif key == 'Concrete and plaster products':
                    concrete_and_plaster_products_mass += value
                elif key == 'Plastics':
                    plastics_mass += value
                elif key == 'Glass':
                    glass_mass += value
                elif key == 'Insulation':
                    insulation_mass += value
                elif key == 'Metals':
                    metals_mass += value
                elif key == 'Miscellaneous':
                    miscellaneous_mass += value
                elif key == 'Sand, stone and ceramics':
                    sand_stone_ceramics_mass += value
                elif key == 'Timber':
                    timber_mass += value
                # Embodied Water by Material Categories
                elif key == 'Insulation_Initial_Embodied_water':
                    Insulation_Initial_Embodied_water += value
                elif key == 'Timber_Initial_Embodied_water':
                    Timber_Initial_Embodied_water += value
                elif key == 'Glass_Initial_Embodied_water':
                    Glass_Initial_Embodied_water += value
                elif key == 'Sand_stone_ceramics_Initial_Embodied_water':
                    Sand_stone_ceramics_Initial_Embodied_water += value
                elif key == 'Miscellaneous_Initial_Embodied_water':
                    Miscellaneous_Initial_Embodied_water += value
                elif key == 'Metals_Initial_Embodied_water':
                    Metals_Initial_Embodied_water += value
                elif key == 'Plastics_Initial_Embodied_water':
                    Plastics_Initial_Embodied_water += value
                elif key == 'Concrete_plaster_products_Initial_Embodied_water':
                    Concrete_plaster_products_Initial_Embodied_water += value
                # Embodied Energy by Material Categories
                elif key == 'Insulation_Initial_Embodied_energy':
                    Insulation_Initial_Embodied_energy += value
                elif key == 'Timber_Initial_Embodied_energy':
                    Timber_Initial_Embodied_energy += value
                elif key == 'Glass_Initial_Embodied_energy':
                    Glass_Initial_Embodied_energy += value
                elif key == 'Sand_stone_ceramics_Initial_Embodied_energy':
                    Sand_stone_ceramics_Initial_Embodied_energy += value
                elif key == 'Miscellaneous_Initial_Embodied_energy':
                    Miscellaneous_Initial_Embodied_energy += value
                elif key == 'Metals_Initial_Embodied_energy':
                    Metals_Initial_Embodied_energy += value
                elif key == 'Plastics_Initial_Embodied_energy':
                    Plastics_Initial_Embodied_energy += value
                elif key == 'Concrete_plaster_products_Initial_Embodied_energy':
                    Concrete_plaster_products_Initial_Embodied_energy += value
                # Embodied GHG by Material Categories
                elif key == 'Insulation_Initial_Embodied_GHG':
                    Insulation_Initial_Embodied_GHG += value
                elif key == 'Timber_Initial_Embodied_GHG':
                    Timber_Initial_Embodied_GHG += value
                elif key == 'Glass_Initial_Embodied_GHG':
                    Glass_Initial_Embodied_GHG += value
                elif key == 'Sand_stone_ceramics_Initial_Embodied_GHG':
                    Sand_stone_ceramics_Initial_Embodied_GHG += value
                elif key == 'Miscellaneous_Initial_Embodied_GHG':
                    Miscellaneous_Initial_Embodied_GHG += value
                elif key == 'Metals_Initial_Embodied_GHG':
                    Metals_Initial_Embodied_GHG += value
                elif key == 'Plastics_Initial_Embodied_GHG':
                    Plastics_Initial_Embodied_GHG += value
                elif key == 'Concrete_plaster_products_Initial_Embodied_GHG':
                    Concrete_plaster_products_Initial_Embodied_GHG += value
                # Maintenance Embodied Water by Material Categories
                elif key == 'Insulation_Maintenance_Embodied_water':
                    Insulation_Maintenance_Embodied_water += value
                elif key == 'Timber_Maintenance_Embodied_water':
                    Timber_Maintenance_Embodied_water += value
                elif key == 'Glass_Maintenance_Embodied_water':
                    Glass_Maintenance_Embodied_water += value
                elif key == 'Sand_stone_ceramics_Maintenance_Embodied_water':
                    Sand_stone_ceramics_Maintenance_Embodied_water += value
                elif key == 'Miscellaneous_Maintenance_Embodied_water':
                    Miscellaneous_Maintenance_Embodied_water += value
                elif key == 'Metals_Maintenance_Embodied_water':
                    Metals_Maintenance_Embodied_water += value
                elif key == 'Plastics_Maintenance_Embodied_water':
                    Plastics_Maintenance_Embodied_water += value
                elif key == 'Concrete_plaster_products_Maintenance_Embodied_water':
                    Concrete_plaster_products_Maintenance_Embodied_water += value

                # Maintenance Embodied Energy by Material Categories
                elif key == 'Insulation_Maintenance_Embodied_energy':
                    Insulation_Maintenance_Embodied_energy += value
                elif key == 'Timber_Maintenance_Embodied_energy':
                    Timber_Maintenance_Embodied_energy += value
                elif key == 'Glass_Maintenance_Embodied_energy':
                    Glass_Maintenance_Embodied_energy += value
                elif key == 'Sand_stone_ceramics_Maintenance_Embodied_energy':
                    Sand_stone_ceramics_Maintenance_Embodied_energy += value
                elif key == 'Miscellaneous_Maintenance_Embodied_energy':
                    Miscellaneous_Maintenance_Embodied_energy += value
                elif key == 'Metals_Maintenance_Embodied_energy':
                    Metals_Maintenance_Embodied_energy += value
                elif key == 'Plastics_Maintenance_Embodied_energy':
                    Plastics_Maintenance_Embodied_energy += value
                elif key == 'Concrete_plaster_products_Maintenance_Embodied_energy':
                    Concrete_plaster_products_Maintenance_Embodied_energy += value

                # Maintenance Embodied GHG by Material Categories
                elif key == 'Insulation_Maintenance_Embodied_GHG':
                    Insulation_Maintenance_Embodied_GHG += value
                elif key == 'Timber_Maintenance_Embodied_GHG':
                    Timber_Maintenance_Embodied_GHG += value
                elif key == 'Glass_Maintenance_Embodied_GHG':
                    Glass_Maintenance_Embodied_GHG += value
                elif key == 'Sand_stone_ceramics_Maintenance_Embodied_GHG':
                    Sand_stone_ceramics_Maintenance_Embodied_GHG += value
                elif key == 'Miscellaneous_Maintenance_Embodied_GHG':
                    Miscellaneous_Maintenance_Embodied_GHG += value
                elif key == 'Metals_Maintenance_Embodied_GHG':
                    Metals_Maintenance_Embodied_GHG += value
                elif key == 'Plastics_Maintenance_Embodied_GHG':
                    Plastics_Maintenance_Embodied_GHG += value
                elif key == 'Concrete_plaster_products_Maintenance_Embodied_GHG':
                    Concrete_plaster_products_Maintenance_Embodied_GHG += value

        embodied_energy_coefficient /= PKT_million_60_years
        embodied_water_coefficient /= PKT_million_60_years
        embodied_GHG_coefficient /= PKT_million_60_years
        mass /= PKT_million_60_years
        concrete_and_plaster_products_mass /= PKT_million_60_years
        plastics_mass /= PKT_million_60_years
        metals_mass /= PKT_million_60_years
        miscellaneous_mass /= PKT_million_60_years
        sand_stone_ceramics_mass /= PKT_million_60_years
        timber_mass /= PKT_million_60_years
        glass_mass /= PKT_million_60_years
        insulation_mass /= PKT_million_60_years
        operational_energy_coefficient /= PKT_million_60_years
        operational_ghg_coefficient /= PKT_million_60_years
        operational_water_coefficient /= PKT_million_60_years
        maintenance_embodied_energy /= PKT_million_60_years
        maintenance_embodied_ghg /= PKT_million_60_years
        maintenance_embodied_water /= PKT_million_60_years
        maintenance_mass /= PKT_million_60_years

        assembly_data_list = [
            ('assembly_category', assembly_category),
            ('material_service_life', material_service_life),
            ('embodied_energy_coefficient', embodied_energy_coefficient),
            ('embodied_water_coefficient', embodied_water_coefficient),
            ('embodied_GHG_coefficient', embodied_GHG_coefficient),
            ('operational_energy_coefficient', operational_energy_coefficient),
            ('operational_ghg_coefficient', operational_ghg_coefficient),
            ('operational_water_coefficient', operational_water_coefficient),
            ('maintenance_embodied_energy', maintenance_embodied_energy),
            ('maintenance_embodied_ghg', maintenance_embodied_ghg),
            ('maintenance_embodied_water', maintenance_embodied_water),
            ('maintenance_mass', maintenance_mass),
            ('mass', mass),
            ('Concrete and plaster products', concrete_and_plaster_products_mass),
            ('Plastics', plastics_mass),
            ('Glass', glass_mass),
            ('Insulation', insulation_mass),
            ('Metals', metals_mass),
            ('Miscellaneous', miscellaneous_mass),
            ('Sand, stone and ceramics', sand_stone_ceramics_mass),
            ('Timber', timber_mass),
            # Embodied Water by Material Categories
    ('Insulation_Initial_Embodied_water', Insulation_Initial_Embodied_water),
    ('Timber_Initial_Embodied_water', Timber_Initial_Embodied_water),
    ('Glass_Initial_Embodied_water', Glass_Initial_Embodied_water),
    ('Sand_stone_ceramics_Initial_Embodied_water', Sand_stone_ceramics_Initial_Embodied_water),
    ('Miscellaneous_Initial_Embodied_water', Miscellaneous_Initial_Embodied_water),
    ('Metals_Initial_Embodied_water', Metals_Initial_Embodied_water),
    ('Plastics_Initial_Embodied_water', Plastics_Initial_Embodied_water),
    ('Concrete_plaster_products_Initial_Embodied_water', Concrete_plaster_products_Initial_Embodied_water),

    # Embodied Energy by Material Categories
    ('Insulation_Initial_Embodied_energy', Insulation_Initial_Embodied_energy),
    ('Timber_Initial_Embodied_energy', Timber_Initial_Embodied_energy),
    ('Glass_Initial_Embodied_energy', Glass_Initial_Embodied_energy),
    ('Sand_stone_ceramics_Initial_Embodied_energy', Sand_stone_ceramics_Initial_Embodied_energy),
    ('Miscellaneous_Initial_Embodied_energy', Miscellaneous_Initial_Embodied_energy),
    ('Metals_Initial_Embodied_energy', Metals_Initial_Embodied_energy),
    ('Plastics_Initial_Embodied_energy', Plastics_Initial_Embodied_energy),
    ('Concrete_plaster_products_Initial_Embodied_energy', Concrete_plaster_products_Initial_Embodied_energy),

    # Embodied GHG by Material Categories
    ('Insulation_Initial_Embodied_GHG', Insulation_Initial_Embodied_GHG),
    ('Timber_Initial_Embodied_GHG', Timber_Initial_Embodied_GHG),
    ('Glass_Initial_Embodied_GHG', Glass_Initial_Embodied_GHG),
    ('Sand_stone_ceramics_Initial_Embodied_GHG', Sand_stone_ceramics_Initial_Embodied_GHG),
    ('Miscellaneous_Initial_Embodied_GHG', Miscellaneous_Initial_Embodied_GHG),
    ('Metals_Initial_Embodied_GHG', Metals_Initial_Embodied_GHG),
    ('Plastics_Initial_Embodied_GHG', Plastics_Initial_Embodied_GHG),
    ('Concrete_plaster_products_Initial_Embodied_GHG', Concrete_plaster_products_Initial_Embodied_GHG),

    # Maintenance Embodied Water by Material Categories
    ('Insulation_Maintenance_Embodied_water', Insulation_Maintenance_Embodied_water),
    ('Timber_Maintenance_Embodied_water', Timber_Maintenance_Embodied_water),
    ('Glass_Maintenance_Embodied_water', Glass_Maintenance_Embodied_water),
    ('Sand_stone_ceramics_Maintenance_Embodied_water', Sand_stone_ceramics_Maintenance_Embodied_water),
    ('Miscellaneous_Maintenance_Embodied_water', Miscellaneous_Maintenance_Embodied_water),
    ('Metals_Maintenance_Embodied_water', Metals_Maintenance_Embodied_water),
    ('Plastics_Maintenance_Embodied_water', Plastics_Maintenance_Embodied_water),
    ('Concrete_plaster_products_Maintenance_Embodied_water', Concrete_plaster_products_Maintenance_Embodied_water),

    # Maintenance Embodied Energy by Material Categories
    ('Insulation_Maintenance_Embodied_energy', Insulation_Maintenance_Embodied_energy),
    ('Timber_Maintenance_Embodied_energy', Timber_Maintenance_Embodied_energy),
    ('Glass_Maintenance_Embodied_energy', Glass_Maintenance_Embodied_energy),
    ('Sand_stone_ceramics_Maintenance_Embodied_energy', Sand_stone_ceramics_Maintenance_Embodied_energy),
    ('Miscellaneous_Maintenance_Embodied_energy', Miscellaneous_Maintenance_Embodied_energy),
    ('Metals_Maintenance_Embodied_energy', Metals_Maintenance_Embodied_energy),
    ('Plastics_Maintenance_Embodied_energy', Plastics_Maintenance_Embodied_energy),
    ('Concrete_plaster_products_Maintenance_Embodied_energy', Concrete_plaster_products_Maintenance_Embodied_energy),

    # Maintenance Embodied GHG by Material Categories
    ('Insulation_Maintenance_Embodied_GHG', Insulation_Maintenance_Embodied_GHG),
    ('Timber_Maintenance_Embodied_GHG', Timber_Maintenance_Embodied_GHG),
    ('Glass_Maintenance_Embodied_GHG', Glass_Maintenance_Embodied_GHG),
    ('Sand_stone_ceramics_Maintenance_Embodied_GHG', Sand_stone_ceramics_Maintenance_Embodied_GHG),
    ('Miscellaneous_Maintenance_Embodied_GHG', Miscellaneous_Maintenance_Embodied_GHG),
    ('Metals_Maintenance_Embodied_GHG', Metals_Maintenance_Embodied_GHG),
    ('Plastics_Maintenance_Embodied_GHG', Plastics_Maintenance_Embodied_GHG),
    ('Concrete_plaster_products_Maintenance_Embodied_GHG', Concrete_plaster_products_Maintenance_Embodied_GHG),
        ]

        return (
            PKT_million_60_years,
            area,
            null1,
            assembly_data_list,
            embodied_energy_coefficient,
            embodied_water_coefficient,
            embodied_GHG_coefficient,
            operational_energy_coefficient,
            operational_ghg_coefficient,
            operational_water_coefficient,
            maintenance_embodied_energy,
            maintenance_embodied_ghg,
            maintenance_embodied_water,
            maintenance_mass,
            null2,
            mass,
            concrete_and_plaster_products_mass,
            plastics_mass,
            metals_mass,
            miscellaneous_mass,
            sand_stone_ceramics_mass,
            timber_mass,
            glass_mass,
            insulation_mass,
        )
# ---------- end infraset_element ----------
panel = Panel(infraset_element.mass_tonne_PKT)
panel_2 = Panel(infraset_element.assembly_data_list)
addition = Addition(A=infraset_element.Embodied_GHG_Coefficient__kgCO₂e_PKT, B=infraset_element.maintenance_embodied_ghg__kgCO₂e_PKT)
panel_3 = Panel(addition)

# ----
# Infraset_Element (Retaining wall)
list_2 = ValueList({"One": 1, "Two": 2, "Three": 2² - 1, "Four": Sqrt(16), "CSR_Trench_Type_A_Vol", "Drainage_SRP_Slotted_1m_No", "P58_(West)_Station_Extended_Walkway_No", "Pier_50MPa_Vol", "B2M_Crosshead_CC4_No", "L_Wall_Base_Slab_Vol"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}, selected="Tram_post_0.2tonne_6meters_No")
infraset_element_2 = GhPythonScript(
    create_list=Toggle(True),
    Infraset_element_ID=list_2,
    No_volume=Slider(4814, range=0..10000),
    Material_Service_Life__Years=Slider(60, range=0..100))  # -> element_data, Material_Service_Life__Years, port, Embodied_Energy_Coefficient__MJ, Embodied_Water_Coefficient__L, Embodied_GHG_Coefficient__kgCO₂e, Operational_Energy_coefficient_MJ, Operational_GHG_coefficient_kgCO₂e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; inputs create_list: Boolean, element_data_list: list, Material_Service_Life__Years: Int32
# ---------- infraset_element_2: Python ----------
from ghpythonlib.componentbase import executingcomponent as component
from Backend_InfraSet import MaterialDatabase, ElementDatabase
from Grasshopper.Kernel import GH_RuntimeMessageLevel as RML
from Grasshopper import DataTree
from Grasshopper.Kernel.Data import GH_Path  # Added missing import
from Grasshopper.Kernel import GH_Document
from Grasshopper.Kernel.Special import GH_ValueList, GH_ValueListItem
import System
from System.Drawing import PointF


class InfrasetElement(component):
    def RunScript(self, connect_button, element_category, No, element_data_list, null1, wastage_coefficient, material_service_life, null2, energy_reduction_factor, water_reduction_factor, ghg_reduction_factor):
        # Initialize outputs with proper data structures
        output_tree = DataTree[object]()
        embodied_energy_coefficient = 0.0
        embodied_water_coefficient = 0.0
        embodied_GHG_coefficient = 0.0
        operational_energy_coefficient = 0.0
        operational_ghg_coefficient = 0.0
        operational_water_coefficient = 0.0
        maintenance_embodied_energy = 0.0
        maintenance_embodied_ghg = 0.0
        maintenance_embodied_water = 0.0
        maintenance_mass = 0.0
        mass = 0.0
        concrete_and_plaster_products_mass = 0.0
        plastics_mass = 0.0
        metals_mass = 0.0
        miscellaneous_mass = 0.0
        sand_stone_ceramics_mass = 0.0
        timber_mass = 0.0
        glass_mass = 0.0
        insulation_mass = 0.0
        # Embodied calculations GHG for material categories
        Concrete_plaster_products_Initial_Embodied_GHG= 0.0
        Plastics_Initial_Embodied_GHG= 0.0
        Metals_Initial_Embodied_GHG= 0.0
        Miscellaneous_Initial_Embodied_GHG =0
        Sand_stone_ceramics_Initial_Embodied_GHG= 0.0
        Timber_Initial_Embodied_GHG= 0.0
        Insulation_Initial_Embodied_GHG=0.0
        # Maintenance Embodied GHG calculations for material categories
        Concrete_plaster_products_Maintenance_Embodied_GHG= 0.0
        Plastics_Maintenance_Embodied_GHG= 0.0
        Metals_Maintenance_Embodied_GHG= 0.0
        Miscellaneous_Maintenance_Embodied_GHG =0
        Sand_stone_ceramics_Maintenance_Embodied_GHG= 0.0
        Timber_Maintenance_Embodied_GHG= 0.0
        Insulation_Maintenance_Embodied_GHG=0.0
        # Embodied calculations energy for material categories
        Concrete_plaster_products_Initial_Embodied_energy= 0.0
        Plastics_Initial_Embodied_energy= 0.0
        Metals_Initial_Embodied_energy= 0.0
        Miscellaneous_Initial_Embodied_energy =0
        Sand_stone_ceramics_Initial_Embodied_energy= 0.0
        Timber_Initial_Embodied_energy= 0.0
        Insulation_Initial_Embodied_energy=0.0
        # Maintenance Embodied energy calculations for material categories
        Concrete_plaster_products_Maintenance_Embodied_energy= 0.0
        Plastics_Maintenance_Embodied_energy= 0.0
        Metals_Maintenance_Embodied_energy= 0.0
        Miscellaneous_Maintenance_Embodied_energy =0
        Sand_stone_ceramics_Maintenance_Embodied_energy= 0.0
        Timber_Maintenance_Embodied_energy= 0.0
        Insulation_Maintenance_Embodied_energy=0.0
                # Embodied calculations water for material categories
        Concrete_plaster_products_Initial_Embodied_water= 0.0
        Plastics_Initial_Embodied_water= 0.0
        Metals_Initial_Embodied_water= 0.0
        Miscellaneous_Initial_Embodied_water =0
        Sand_stone_ceramics_Initial_Embodied_water= 0.0
        Timber_Initial_Embodied_water= 0.0
        Insulation_Initial_Embodied_water=0.0
        # Maintenance Embodied energy calculations for material categories
        Concrete_plaster_products_Maintenance_Embodied_water= 0.0
        Plastics_Maintenance_Embodied_water= 0.0
        Metals_Maintenance_Embodied_water= 0.0
        Miscellaneous_Maintenance_Embodied_water =0
        Sand_stone_ceramics_Maintenance_Embodied_water= 0.0
        Timber_Maintenance_Embodied_water= 0.0
        Insulation_Maintenance_Embodied_water=0.0
        


        # Initialize databases
        material_db = MaterialDatabase()
        element_db = ElementDatabase(material_db.material_db)
        
        try:
            element_db.populate_elements()
        except:
            self.AddRuntimeMessage(RML.Warning, "Failed to populate element database")
            return

        # Create value list when button is pressed
        if connect_button and self.Params.Input[1].SourceCount == 0:
            try:
                # Filter element categories to only include allowed infrastructure elements
                element_categories = [cat for cat in element_db.element_db.keys()]
                
                # Create value list component
                vl = GH_ValueList()
                vl.CreateAttributes()
                
                # Populate with filtered categories using legacy string formatting
                for cat in element_categories:
                    item = GH_ValueListItem(cat, '"%s"' % cat)  # IronPython compatible formatting
                    vl.ListItems.Add(item)
                
                # Position value list to the left of the component
                vl.Attributes.Pivot = PointF(
                    self.Params.Input[1].Attributes.Pivot.X - 250,
                    self.Params.Input[1].Attributes.Pivot.Y
                )
                
                # Add to document and connect
                ghdoc = self.OnPingDocument()
                ghdoc.AddObject(vl, False)
                self.Params.Input[1].AddSource(vl)
                self.Params.OnParametersChanged()
                ghdoc.ScheduleSolution(5, GH_Document.GH_ScheduleDelegate(self.ExpireSolution))
                
            except Exception as e:
                self.AddRuntimeMessage(RML.Error, "Value list creation failed: {0}".format(str(e)))

        # Main calculations
        element_data = {}
        if element_category and element_db.element_db:
            element_data = element_db.element_db.get(str(element_category), {})
            if element_data:
                # Handle input defaults
                No = No or 1
                wastage = (wastage_coefficient or 0) / 100.0
                material_service_life = material_service_life or 60
                energy_red = (energy_reduction_factor or 0) / 100.0
                water_red = (water_reduction_factor or 0) / 100.0
                ghg_red = (ghg_reduction_factor or 0) / 100.0

                try:
                    # Embodied calculations
                    embodied_energy = element_data.get("Initial_Embodied_Energy_(MJ)", 0)
                    embodied_water = element_data.get("Initial_Embodied_Water_(L)", 0)
                    embodied_GHG = element_data.get("Initial_Embodied_GHG_(kgCO2e)", 0)
                    
                    embodied_energy_coefficient = embodied_energy * (1 + wastage) * No * (1 - energy_red)
                    embodied_water_coefficient = embodied_water * (1 + wastage) * No * (1 - water_red)
                    embodied_GHG_coefficient = embodied_GHG * (1 + wastage) * No * (1 - ghg_red)

                    # Mass calculations
                    mass = element_data.get("Total_Mass_(kg)", 0) * (1 + wastage) * No * 0.001
                    concrete_and_plaster_products_mass = element_data.get("Concrete and plaster products_Mass_(kg)", 0) * (1 + wastage) * No * 0.001
                    plastics_mass = element_data.get("Plastics_Mass_(kg)", 0) * (1 + wastage) * No * 0.001
                    metals_mass = element_data.get("Metals_Mass_(kg)", 0) * (1 + wastage) * No * 0.001
                    miscellaneous_mass = element_data.get("Miscellaneous_Mass_(kg)", 0) * (1 + wastage) * No * 0.001
                    sand_stone_ceramics_mass = element_data.get("Sand, stone and ceramics_Mass_(kg)", 0) * (1 + wastage) * No * 0.001
                    timber_mass = element_data.get("Timber_Mass_(kg)", 0) * (1 + wastage) * No * 0.001
                    glass_mass = element_data.get("Glass_Mass_(kg)", 0) * (1 + wastage) * No * 0.001
                    insulation_mass = element_data.get("Insulation_Mass_(kg)", 0) * (1 + wastage) * No * 0.001

                    # Maintenance calculations
                    maintenance_embodied_energy = element_data.get("Maintenance_Embodied_Energy_(MJ)", 0) * No * (material_service_life / 60)
                    maintenance_embodied_ghg = element_data.get("Maintenance_Embodied_GHG_(kgCO2e)", 0) * No * (material_service_life / 60)
                    maintenance_embodied_water = element_data.get("Maintenance_Embodied_Water_(L)", 0) * No *(material_service_life / 60)
                    maintenance_mass = element_data.get("Maintenance_Mass_(kg)", 0) * No * 0.001 *(material_service_life / 60)
                    
                    # Embodied calculations GHG for material categories
                    Concrete_plaster_products_Initial_Embodied_GHG = element_data.get("Concrete and plaster products_Initial_Embodied_GHG_(kgCO2e)", 0) * No * (material_service_life / 60)
                    Plastics_Initial_Embodied_GHG = element_data.get("Plastics_Initial_Embodied_GHG_(kgCO2e)", 0) * No * (material_service_life / 60)
                    Metals_Initial_Embodied_GHG = element_data.get("Metals_Initial_Embodied_GHG_(kgCO2e)", 0) * No * (material_service_life / 60)
                    Miscellaneous_Initial_Embodied_GHG = element_data.get("Miscellaneous_Initial_Embodied_GHG_(kgCO2e)", 0) * No * (material_service_life / 60)
                    Sand_stone_ceramics_Initial_Embodied_GHG = element_data.get("Sand, stone and ceramics_Initial_Embodied_GHG_(kgCO2e)", 0) * No * (material_service_life / 60)
                    Glass_Initial_Embodied_GHG = element_data.get("Glass_Initial_Embodied_GHG_(kgCO2e)", 0) * No * (material_service_life / 60)
                    Timber_Initial_Embodied_GHG = element_data.get("Timber_Initial_Embodied_GHG_(kgCO2e)", 0) * No * (material_service_life / 60)
                    Insulation_Initial_Embodied_GHG = element_data.get("Insulation_Initial_Embodied_GHG_(kgCO2e)", 0) * No * (material_service_life / 60)
                    
                    # Maintenance Embodied GHG calculations for material categories
                    Concrete_plaster_products_Maintenance_Embodied_GHG = element_data.get("Concrete and plaster products_Maintenance_Embodied_GHG_(kgCO2e)", 0) * No * (material_service_life / 60)
                    Plastics_Maintenance_Embodied_GHG = element_data.get("Plastics_Maintenance_Embodied_GHG_(kgCO2e)", 0) * No * (material_service_life / 60)
                    Metals_Maintenance_Embodied_GHG = element_data.get("Metals_Maintenance_Embodied_GHG_(kgCO2e)", 0) * No * (material_service_life / 60)
                    Miscellaneous_Maintenance_Embodied_GHG = element_data.get("Miscellaneous_Maintenance_Embodied_GHG_(kgCO2e)", 0) * No * (material_service_life / 60)
                    Sand_stone_ceramics_Maintenance_Embodied_GHG = element_data.get("Sand, stone and ceramics_Maintenance_Embodied_GHG_(kgCO2e)", 0) * No * (material_service_life / 60)
                    Glass_Maintenance_Embodied_GHG = element_data.get("Glass_Maintenance_Embodied_GHG_(kgCO2e)", 0) * No * (material_service_life / 60)
                    Timber_Maintenance_Embodied_GHG = element_data.get("Timber_Maintenance_Embodied_GHG_(kgCO2e)", 0) * No * (material_service_life / 60)
                    Insulation_Maintenance_Embodied_GHG = element_data.get("Insulation_Maintenance_Embodied_GHG_(kgCO2e)", 0) * No * (material_service_life / 60)
                    
                    # Embodied calculations Energy for material categories
                    Concrete_plaster_products_Initial_Embodied_energy = element_data.get("Concrete and plaster products_Initial_Embodied_energy_(MJ)", 0) * No * (material_service_life / 60)
                    Plastics_Initial_Embodied_energy = element_data.get("Plastics_Initial_Embodied_energy_(MJ)", 0) * No * (material_service_life / 60)
                    Metals_Initial_Embodied_energy = element_data.get("Metals_Initial_Embodied_energy_(MJ)", 0) * No * (material_service_life / 60)
                    Miscellaneous_Initial_Embodied_energy = element_data.get("Miscellaneous_Initial_Embodied_energy_(MJ)", 0) * No * (material_service_life / 60)
                    Sand_stone_ceramics_Initial_Embodied_energy = element_data.get("Sand, stone and ceramics_Initial_Embodied_energy_(MJ)", 0) * No * (material_service_life / 60)
                    Glass_Initial_Embodied_energy = element_data.get("Glass_Initial_Embodied_energy_(MJ)", 0) * No * (material_service_life / 60)
                    Timber_Initial_Embodied_energy = element_data.get("Timber_Initial_Embodied_energy_(MJ)", 0) * No * (material_service_life / 60)
                    Insulation_Initial_Embodied_energy = element_data.get("Insulation_Initial_Embodied_energy_(MJ)", 0) * No * (material_service_life / 60)
                    
                    # Maintenance Embodied Energy calculations for material categories
                    Concrete_plaster_products_Maintenance_Embodied_energy = element_data.get("Concrete and plaster products_Maintenance_Embodied_energy_(MJ)", 0) * No * (material_service_life / 60)
                    Plastics_Maintenance_Embodied_energy = element_data.get("Plastics_Maintenance_Embodied_energy_(MJ)", 0) * No * (material_service_life / 60)
                    Metals_Maintenance_Embodied_energy = element_data.get("Metals_Maintenance_Embodied_energy_(MJ)", 0) * No * (material_service_life / 60)
                    Miscellaneous_Maintenance_Embodied_energy = element_data.get("Miscellaneous_Maintenance_Embodied_energy_(MJ)", 0) * No * (material_service_life / 60)
                    Sand_stone_ceramics_Maintenance_Embodied_energy = element_data.get("Sand, stone and ceramics_Maintenance_Embodied_energy_(MJ)", 0) * No * (material_service_life / 60)
                    Glass_Maintenance_Embodied_energy = element_data.get("Glass_Maintenance_Embodied_energy_(MJ)", 0) * No * (material_service_life / 60)
                    Timber_Maintenance_Embodied_energy = element_data.get("Timber_Maintenance_Embodied_energy_(MJ)", 0) * No * (material_service_life / 60)
                    Insulation_Maintenance_Embodied_energy = element_data.get("Insulation_Maintenance_Embodied_energy_(MJ)", 0) * No * (material_service_life / 60)
                    
                    # Embodied calculations water for material categories
                    Concrete_plaster_products_Initial_Embodied_water = element_data.get("Concrete and plaster products_Initial_embodied_water_(L)", 0) * No * (material_service_life / 60)
                    Plastics_Initial_Embodied_water = element_data.get("Plastics_Initial_Embodied_water_(L)", 0) * No * (material_service_life / 60)
                    Metals_Initial_Embodied_water = element_data.get("Metals_Initial_Embodied_water_(L)", 0) * No * (material_service_life / 60)
                    Miscellaneous_Initial_Embodied_water = element_data.get("Miscellaneous_Initial_Embodied_water_(L)", 0) * No * (material_service_life / 60)
                    Sand_stone_ceramics_Initial_Embodied_water = element_data.get("Sand, stone and ceramics_Initial_Embodied_water_(L)", 0) * No * (material_service_life / 60)
                    Glass_Initial_Embodied_water = element_data.get("Glass_Initial_Embodied_energy_(MJ)", 0) * No * (material_service_life / 60)
                    Timber_Initial_Embodied_water = element_data.get("Timber_Initial_Embodied_energy_(MJ)", 0) * No * (material_service_life / 60)
                    Insulation_Initial_Embodied_water = element_data.get("Insulation_Initial_Embodied_energy_(MJ)", 0) * No * (material_service_life / 60)
                    
                    # Maintenance Embodied water calculations for material categories
                    Concrete_plaster_products_Maintenance_Embodied_energy = element_data.get("Concrete and plaster products_Maintenance_Embodied_Water_(L)", 0) * No * (material_service_life / 60)
                    Plastics_Maintenance_Embodied_water = element_data.get("Plastics_Maintenance_Embodied_Water_(L)", 0) * No * (material_service_life / 60)
                    Metals_Maintenance_Embodied_water = element_data.get("Metals_Maintenance_Embodied_Water_(L)", 0) * No * (material_service_life / 60)
                    Miscellaneous_Maintenance_Embodied_water = element_data.get("Miscellaneous_Maintenance_Embodied_Water_(L)", 0) * No * (material_service_life / 60)
                    Sand_stone_ceramics_Maintenance_Embodied_water = element_data.get("Sand, stone and ceramics_Maintenance_Embodied_Water_(L)", 0) * No * (material_service_life / 60)
                    Glass_Maintenance_Embodied_water = element_data.get("Glass_Maintenance_Embodied_Water_(L)", 0) * No * (material_service_life / 60)
                    Timber_Maintenance_Embodied_water = element_data.get("Timber_Maintenance_Embodied_Water_(L)", 0) * No * (material_service_life / 60)
                    Insulation_Maintenance_Embodied_water = element_data.get("Insulation_Maintenance_Embodied_Water_(L)", 0) * No * (material_service_life / 60)


                except KeyError as e:
                    self.AddRuntimeMessage(RML.Warning, "Missing data key: {0}".format(str(e)))

        # Process input DataTree correctly
        if element_data_list:
            for i in range(element_data_list.BranchCount):
                branch = element_data_list.Branch(i)
                for item in branch:
                    if isinstance(item, tuple) and len(item) == 2:
                        key, value = item
                        if key == 'embodied_energy_coefficient':
                            embodied_energy_coefficient += value
                        elif key == 'embodied_water_coefficient':
                            embodied_water_coefficient += value
                        elif key == 'embodied_GHG_coefficient':
                            embodied_GHG_coefficient += value
                        elif key == 'mass':
                            mass += value
                        elif key == 'Concrete and plaster products':
                            concrete_and_plaster_products_mass += value
                        elif key == 'Plastics':
                            plastics_mass += value
                        elif key == 'Glass':
                            glass_mass += value
                        elif key == 'Insulation':
                            insulation_mass += value
                        elif key == 'Metals':
                            metals_mass += value
                        elif key == 'Miscellaneous':
                            miscellaneous_mass += value
                        elif key == 'Sand, stone and ceramics':
                            sand_stone_ceramics_mass += value
                        elif key == 'Timber':
                            timber_mass += value
                        elif key == 'operational_energy_coefficient':
                            operational_energy_coefficient += value
                        elif key == 'operational_ghg_coefficient':
                            operational_ghg_coefficient += value
                        elif key == 'operational_water_coefficient':
                            operational_water_coefficient += value
                        elif key == 'maintenance_embodied_energy':
                            maintenance_embodied_energy += value
                        elif key == 'maintenance_embodied_ghg':
                            maintenance_embodied_ghg += value
                        elif key == 'maintenance_embodied_water':
                            maintenance_embodied_water += value
                        elif key == 'maintenance_mass':
                            maintenance_mass += value
                        ## Maintenance Embodied water calculations for material categories
                        elif key == 'Insulation_Maintenance_Embodied_water':
                           Insulation_Maintenance_Embodied_water += value
                        elif key == 'Timber_Maintenance_Embodied_water':
                            Timber_Maintenance_Embodied_water += value
                        elif key == 'Glass_Maintenance_Embodied_water':
                            Glass_Maintenance_Embodied_water += value
                        elif key == 'Sand_stone_ceramics_Maintenance_Embodied_water':
                            Sand_stone_ceramics_Maintenance_Embodied_water += value
                        elif key == 'Miscellaneous_Maintenance_Embodied_water':
                            Miscellaneous_Maintenance_Embodied_water += value
                        elif key == 'Metals_Maintenance_Embodied_water':
                            Metals_Maintenance_Embodied_water += value
                        elif key == 'Plastics_Maintenance_Embodied_water':
                            Plastics_Maintenance_Embodied_water += value
                        elif key == 'Concrete_plaster_products_Maintenance_Embodied_energy':
                            Concrete_plaster_products_Maintenance_Embodied_energy += value
                        # Embodied calculations water for material categories
                        elif key == 'Insulation_Initial_Embodied_water':
                            Insulation_Initial_Embodied_water += value
                        elif key == 'Timber_Initial_Embodied_water':
                            Timber_Initial_Embodied_water += value
                        elif key == 'Glass_Initial_Embodied_water':
                            Glass_Initial_Embodied_water += value
                        elif key == 'Sand_stone_ceramics_Initial_Embodied_water':
                            Sand_stone_ceramics_Initial_Embodied_water += value
                        elif key == 'Miscellaneous_Initial_Embodied_water':
                            Miscellaneous_Initial_Embodied_water += value
                        elif key == 'Metals_Initial_Embodied_water':
                            Metals_Initial_Embodied_water += value
                        elif key == 'Plastics_Initial_Embodied_water':
                            Plastics_Initial_Embodied_water += value
                        elif key == 'Concrete_plaster_products_Initial_Embodied_water':
                            Concrete_plaster_products_Initial_Embodied_water += value
                       # Maintenance Embodied Energy calculations for material categories
                        elif key == 'Concrete_plaster_products_Maintenance_Embodied_energy':
                            Concrete_plaster_products_Maintenance_Embodied_energy += value
                        elif key == 'Plastics_Maintenance_Embodied_energy':
                            Plastics_Maintenance_Embodied_energy += value
                        elif key == 'Metals_Maintenance_Embodied_energy':
                            Metals_Maintenance_Embodied_energy += value
                        elif key == 'Miscellaneous_Maintenance_Embodied_energy':
                            Miscellaneous_Maintenance_Embodied_energy += value
                        elif key == 'Sand_stone_ceramics_Maintenance_Embodied_energy':
                            Sand_stone_ceramics_Maintenance_Embodied_energy += value
                        elif key == 'Glass_Maintenance_Embodied_energy':
                            Glass_Maintenance_Embodied_energy += value
                        elif key == 'Timber_Maintenance_Embodied_energy':
                            Timber_Maintenance_Embodied_energy += value
                        elif key == 'Insulation_Maintenance_Embodied_energy':
                            Insulation_Maintenance_Embodied_energy += value
                       # Embodied calculations Energy for material categories
                        elif key == 'Concrete_plaster_products_Initial_Embodied_energy':
                            Concrete_plaster_products_Initial_Embodied_energy += value
                        elif key == 'Plastics_Initial_Embodied_energy':
                            Plastics_Initial_Embodied_energy += value
                        elif key == 'Metals_Initial_Embodied_energy':
                            Metals_Initial_Embodied_energy += value
                        elif key == 'Miscellaneous_Initial_Embodied_energy':
                            Miscellaneous_Initial_Embodied_energy += value
                        elif key == 'Sand_stone_ceramics_Initial_Embodied_energy':
                            Sand_stone_ceramics_Initial_Embodied_energy += value
                        elif key == 'Glass_Initial_Embodied_energy':
                            Glass_Initial_Embodied_energy += value
                        elif key == 'Timber_Initial_Embodied_energy':
                            Timber_Initial_Embodied_energy += value
                        elif key == 'Insulation_Initial_Embodied_energy':
                            Insulation_Initial_Embodied_energy += value
                       # Maintenance Embodied GHG calculations for material categories
                        elif key == 'Concrete_plaster_products_Maintenance_Embodied_GHG':
                            Concrete_plaster_products_Maintenance_Embodied_GHG += value
                        elif key == 'Plastics_Maintenance_Embodied_GHG':
                            Plastics_Maintenance_Embodied_GHG += value
                        elif key == 'Metals_Maintenance_Embodied_GHG':
                            Metals_Maintenance_Embodied_GHG += value
                        elif key == 'Miscellaneous_Maintenance_Embodied_GHG':
                            Miscellaneous_Maintenance_Embodied_GHG += value
                        elif key == 'Sand_stone_ceramics_Maintenance_Embodied_GHG':
                            Sand_stone_ceramics_Maintenance_Embodied_GHG += value
                        elif key == 'Glass_Maintenance_Embodied_GHG':
                            Glass_Maintenance_Embodied_GHG += value
                        elif key == 'Timber_Maintenance_Embodied_GHG':
                            Timber_Maintenance_Embodied_GHG += value
                        elif key == 'Insulation_Maintenance_Embodied_GHG':
                            Insulation_Maintenance_Embodied_GHG += value
                       # Embodied calculations GHG for material categories
                        elif key == 'Concrete_plaster_products_Initial_Embodied_GHG':
                            Concrete_plaster_products_Initial_Embodied_GHG += value
                        elif key == 'Plastics_Initial_Embodied_GHG':
                            Plastics_Initial_Embodied_GHG += value
                        elif key == 'Metals_Initial_Embodied_GHG':
                            Metals_Initial_Embodied_GHG += value
                        elif key == 'Miscellaneous_Initial_Embodied_GHG':
                            Miscellaneous_Initial_Embodied_GHG += value
                        elif key == 'Sand_stone_ceramics_Initial_Embodied_GHG':
                            Sand_stone_ceramics_Initial_Embodied_GHG += value
                        elif key == 'Glass_Initial_Embodied_GHG':
                            Glass_Initial_Embodied_GHG += value
                        elif key == 'Timber_Initial_Embodied_GHG':
                            Timber_Initial_Embodied_GHG += value
                        elif key == 'Insulation_Initial_Embodied_GHG':
                            Insulation_Initial_Embodied_GHG += value

        # Build output DataTree
        path = GH_Path(0)
        output_tree.AddRange([
            ('element_category', element_category),
            ('material_service_life', material_service_life),
            ('embodied_energy_coefficient', embodied_energy_coefficient),
            ('embodied_water_coefficient', embodied_water_coefficient),
            ('embodied_GHG_coefficient', embodied_GHG_coefficient),
            ('operational_energy_coefficient', operational_energy_coefficient),
            ('operational_ghg_coefficient', operational_ghg_coefficient),
            ('operational_water_coefficient', operational_water_coefficient),
            ('maintenance_embodied_energy', maintenance_embodied_energy),
            ('maintenance_embodied_ghg', maintenance_embodied_ghg),
            ('maintenance_embodied_water', maintenance_embodied_water),
            ('maintenance_mass', maintenance_mass),
            ('mass', mass),
            ('Concrete and plaster products', concrete_and_plaster_products_mass),
            ('Plastics', plastics_mass),
            ('Glass', glass_mass),
            ('Insulation', insulation_mass),
            ('Metals', metals_mass),
            ('Miscellaneous', miscellaneous_mass),
            ('Sand, stone and ceramics', sand_stone_ceramics_mass),
            ('Timber', timber_mass),
            ## Maintenance Embodied water calculations for material categories
            ('Insulation_Maintenance_Embodied_water', Insulation_Maintenance_Embodied_water),
            ('Timber_Maintenance_Embodied_water', Timber_Maintenance_Embodied_water),
            ('Glass_Maintenance_Embodied_water', Glass_Maintenance_Embodied_water),
            ('Sand_stone_ceramics_Maintenance_Embodied_water', Sand_stone_ceramics_Maintenance_Embodied_water),
            ('Miscellaneous_Maintenance_Embodied_water', Miscellaneous_Maintenance_Embodied_water),
            ('Metals_Maintenance_Embodied_water', Metals_Maintenance_Embodied_water),
            ('Plastics_Maintenance_Embodied_water', Plastics_Maintenance_Embodied_water),
            # Embodied calculations water for material categories
            ('Insulation_Initial_Embodied_water', Insulation_Initial_Embodied_water),
            ('Timber_Initial_Embodied_water', Timber_Initial_Embodied_water),
            ('Glass_Initial_Embodied_water', Glass_Initial_Embodied_water),
            ('Sand_stone_ceramics_Initial_Embodied_water', Sand_stone_ceramics_Initial_Embodied_water),
            ('Miscellaneous_Initial_Embodied_water', Miscellaneous_Initial_Embodied_water),
            ('Metals_Initial_Embodied_water', Metals_Initial_Embodied_water),
            ('Plastics_Initial_Embodied_water', Plastics_Initial_Embodied_water),
            ('Concrete_plaster_products_Initial_Embodied_water', Concrete_plaster_products_Initial_Embodied_water),
            # Maintenance Embodied Energy calculations for material categories
            ('Concrete_plaster_products_Maintenance_Embodied_energy', Concrete_plaster_products_Maintenance_Embodied_energy),
    ('Plastics_Maintenance_Embodied_energy', Plastics_Maintenance_Embodied_energy),
    ('Metals_Maintenance_Embodied_energy', Metals_Maintenance_Embodied_energy),
    ('Miscellaneous_Maintenance_Embodied_energy', Miscellaneous_Maintenance_Embodied_energy),
    ('Sand_stone_ceramics_Maintenance_Embodied_energy', Sand_stone_ceramics_Maintenance_Embodied_energy),
    ('Glass_Maintenance_Embodied_energy', Glass_Maintenance_Embodied_energy),
    ('Timber_Maintenance_Embodied_energy', Timber_Maintenance_Embodied_energy),
    ('Insulation_Maintenance_Embodied_energy', Insulation_Maintenance_Embodied_energy),
                       # Embodied calculations Energy for material categories
                       ('Concrete_plaster_products_Initial_Embodied_energy', Concrete_plaster_products_Initial_Embodied_energy),
    ('Plastics_Initial_Embodied_energy', Plastics_Initial_Embodied_energy),
    ('Metals_Initial_Embodied_energy', Metals_Initial_Embodied_energy),
    ('Miscellaneous_Initial_Embodied_energy', Miscellaneous_Initial_Embodied_energy),
    ('Sand_stone_ceramics_Initial_Embodied_energy', Sand_stone_ceramics_Initial_Embodied_energy),
    ('Glass_Initial_Embodied_energy', Glass_Initial_Embodied_energy),
    ('Timber_Initial_Embodied_energy', Timber_Initial_Embodied_energy),
    ('Insulation_Initial_Embodied_energy', Insulation_Initial_Embodied_energy),
                       # Maintenance Embodied GHG calculations for material categories
                       ('Concrete_plaster_products_Maintenance_Embodied_GHG', Concrete_plaster_products_Maintenance_Embodied_GHG),
    ('Plastics_Maintenance_Embodied_GHG', Plastics_Maintenance_Embodied_GHG),
    ('Metals_Maintenance_Embodied_GHG', Metals_Maintenance_Embodied_GHG),
    ('Miscellaneous_Maintenance_Embodied_GHG', Miscellaneous_Maintenance_Embodied_GHG),
    ('Sand_stone_ceramics_Maintenance_Embodied_GHG', Sand_stone_ceramics_Maintenance_Embodied_GHG),
    ('Glass_Maintenance_Embodied_GHG', Glass_Maintenance_Embodied_GHG),
    ('Timber_Maintenance_Embodied_GHG', Timber_Maintenance_Embodied_GHG),
    ('Insulation_Maintenance_Embodied_GHG', Insulation_Maintenance_Embodied_GHG),
                       # Embodied calculations GHG for material categories
                       ('Concrete_plaster_products_Initial_Embodied_GHG', Concrete_plaster_products_Initial_Embodied_GHG),
    ('Plastics_Initial_Embodied_GHG', Plastics_Initial_Embodied_GHG),
    ('Metals_Initial_Embodied_GHG', Metals_Initial_Embodied_GHG),
    ('Miscellaneous_Initial_Embodied_GHG', Miscellaneous_Initial_Embodied_GHG),
    ('Sand_stone_ceramics_Initial_Embodied_GHG', Sand_stone_ceramics_Initial_Embodied_GHG),
    ('Glass_Initial_Embodied_GHG', Glass_Initial_Embodied_GHG),
    ('Timber_Initial_Embodied_GHG', Timber_Initial_Embodied_GHG),
    ('Insulation_Initial_Embodied_GHG', Insulation_Initial_Embodied_GHG),
        ], path)

        return (
            output_tree,
            material_service_life,
            null1,
            embodied_energy_coefficient,
            embodied_water_coefficient,
            embodied_GHG_coefficient,
            operational_energy_coefficient,
            operational_ghg_coefficient,
            operational_water_coefficient,
            maintenance_embodied_energy,
            maintenance_embodied_ghg,
            maintenance_embodied_water,
            maintenance_mass,
            null2,
            mass,
            concrete_and_plaster_products_mass,
            plastics_mass,
            metals_mass,
            miscellaneous_mass,
            sand_stone_ceramics_mass,
            timber_mass,
            glass_mass,
            insulation_mass
        )
# ---------- end infraset_element_2 ----------
panel_4 = Panel(infraset_element_2.mass_Tonne)
addition_2 = Addition(A=infraset_element_2.Embodied_GHG_Coefficient__kgCO₂e, B=infraset_element_2.Maintenance_embodied_GHG_kgCO₂e)
panel_5 = Panel(infraset_element_2.element_data)

infraset_element_3 = GhPythonScript(assembly_data_list1=infraset_element.assembly_data_list)  # -> final_assembly_data_list, Embodied_Energy_Coefficient__MJ, Embodied_Water_Coefficient__L, Embodied_GHG_Coefficient__kgCO₂e, Operational_Energy_coefficient_MJ_No, Operational_GHG_coefficient_kgCO₂e_No, Operational_water_coefficient_L_No, maintenance_embodied_energy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; inputs assembly_data_list1: list, assembly_data_list2: list, assembly_data_list3: list, assembly_data_list4: list, assembly_data_list5: list, assembly_data_list6: list, assembly_data_list7: list, assembly_data_list8: list, assembly_data_list9: list, assembly_data_list10: list
# ---------- infraset_element_3: Python ----------
from ghpythonlib.componentbase import executingcomponent as component
import rhinoscriptsyntax as rs
import Rhino.Geometry as rg
import System
from Grasshopper.Kernel import GH_RuntimeMessageLevel as RML


class InfrasetAssembly(component):
    def RunScript(self, Name, assembly_data_list1, assembly_data_list2, assembly_data_list3, assembly_data_list4, assembly_data_list5,
                  assembly_data_list6, assembly_data_list7, assembly_data_list8, assembly_data_list9, assembly_data_list10,
                   null3, energy_reduction_factor, water_reduction_factor, ghg_reduction_factor):

        # Default values for optional inputs
        energy_reduction_factor = energy_reduction_factor or 0
        water_reduction_factor = water_reduction_factor or 0
        ghg_reduction_factor = ghg_reduction_factor or 0

        # Initialize cumulative variables
        embodied_energy_coefficient = 0
        embodied_water_coefficient = 0
        embodied_GHG_coefficient = 0
        operational_energy_coefficient = 0
        operational_ghg_coefficient = 0
        operational_water_coefficient = 0
        mass = 0
        concrete_and_plaster_products = 0
        plastics = 0
        metals = 0
        miscellaneous = 0
        sand_stone_ceramics = 0
        timber = 0
        glass = 0
        insulation = 0
        maintenance_embodied_ghg=0
        maintenance_embodied_water=0
        maintenance_embodied_energy=0
                # Embodied Water by Material Categories
        Insulation_Initial_Embodied_water = 0.0
        Timber_Initial_Embodied_water = 0.0
        Glass_Initial_Embodied_water = 0.0
        Sand_stone_ceramics_Initial_Embodied_water = 0.0
        Miscellaneous_Initial_Embodied_water = 0.0
        Metals_Initial_Embodied_water = 0.0
        Plastics_Initial_Embodied_water = 0.0
        Concrete_plaster_products_Initial_Embodied_water = 0.0
        # Embodied Energy by Material Categories
        Insulation_Initial_Embodied_energy = 0.0
        Timber_Initial_Embodied_energy = 0.0
        Glass_Initial_Embodied_energy = 0.0
        Sand_stone_ceramics_Initial_Embodied_energy = 0.0
        Miscellaneous_Initial_Embodied_energy = 0.0
        Metals_Initial_Embodied_energy = 0.0
        Plastics_Initial_Embodied_energy = 0.0
        Concrete_plaster_products_Initial_Embodied_energy = 0.0
        # Embodied GHG by Material Categories
        Insulation_Initial_Embodied_GHG = 0.0
        Timber_Initial_Embodied_GHG = 0.0
        Glass_Initial_Embodied_GHG = 0.0
        Sand_stone_ceramics_Initial_Embodied_GHG = 0.0
        Miscellaneous_Initial_Embodied_GHG = 0.0
        Metals_Initial_Embodied_GHG = 0.0
        Plastics_Initial_Embodied_GHG = 0.0
        Concrete_plaster_products_Initial_Embodied_GHG = 0.0
        # Maintenance Embodied Metrics
        Insulation_Maintenance_Embodied_water = 0.0
        Timber_Maintenance_Embodied_water = 0.0
        Glass_Maintenance_Embodied_water = 0.0
        Sand_stone_ceramics_Maintenance_Embodied_water = 0.0
        Miscellaneous_Maintenance_Embodied_water = 0.0
        Metals_Maintenance_Embodied_water = 0.0
        Plastics_Maintenance_Embodied_water = 0.0
        Concrete_plaster_products_Maintenance_Embodied_water = 0.0
        Insulation_Maintenance_Embodied_energy = 0.0
        Timber_Maintenance_Embodied_energy = 0.0
        Glass_Maintenance_Embodied_energy = 0.0
        Sand_stone_ceramics_Maintenance_Embodied_energy = 0.0
        Miscellaneous_Maintenance_Embodied_energy = 0.0
        Metals_Maintenance_Embodied_energy = 0.0
        Plastics_Maintenance_Embodied_energy = 0.0
        Concrete_plaster_products_Maintenance_Embodied_energy = 0.0
        Insulation_Maintenance_Embodied_GHG = 0.0
        Timber_Maintenance_Embodied_GHG = 0.0
        Glass_Maintenance_Embodied_GHG = 0.0
        Sand_stone_ceramics_Maintenance_Embodied_GHG = 0.0
        Miscellaneous_Maintenance_Embodied_GHG = 0.0
        Metals_Maintenance_Embodied_GHG = 0.0
        Plastics_Maintenance_Embodied_GHG = 0.0
        Concrete_plaster_products_Maintenance_Embodied_GHG = 0.0

        # Combine all assembly data lists into one list
        all_assembly_data_lists = [
            assembly_data_list1, assembly_data_list2, assembly_data_list3, assembly_data_list4, assembly_data_list5,
            assembly_data_list6, assembly_data_list7, assembly_data_list8, assembly_data_list9, assembly_data_list10
        ]

        # Filter out None values
        all_assembly_data_lists = [data for data in all_assembly_data_lists if data is not None]

        # Process each assembly data list to aggregate the values
        for assembly_data_list in all_assembly_data_lists:
            for key, value in assembly_data_list:
                if key == 'embodied_energy_coefficient':
                    embodied_energy_coefficient += value
                elif key == 'embodied_water_coefficient':
                    embodied_water_coefficient += value
                elif key == 'embodied_GHG_coefficient':
                    embodied_GHG_coefficient += value
                elif key == 'operational_energy_coefficient':
                    operational_energy_coefficient += value
                elif key == 'operational_ghg_coefficient':
                    operational_ghg_coefficient += value
                elif key == 'operational_water_coefficient':
                    operational_water_coefficient += value
                elif key == 'maintenance_embodied_water':
                    maintenance_embodied_water += value
                elif key == 'maintenance_embodied_ghg':
                    maintenance_embodied_ghg += value
                elif key == 'maintenance_embodied_energy':
                    maintenance_embodied_energy += value
                elif key == 'mass':
                    mass += value
                elif key == 'Concrete and plaster products':
                    concrete_and_plaster_products += value
                elif key == 'Plastics':
                    plastics += value
                elif key == 'Metals':
                    metals += value
                elif key == 'Miscellaneous':
                    miscellaneous += value
                elif key == 'Sand, stone and ceramics':
                    sand_stone_ceramics += value
                elif key == 'Timber':
                    timber += value
                elif key == 'Glass':
                    glass += value
                elif key == 'Insulation':
                    insulation += value
                                # Embodied Water by Material Categories
                elif key == 'Insulation_Initial_Embodied_water':
                    Insulation_Initial_Embodied_water += value
                elif key == 'Timber_Initial_Embodied_water':
                    Timber_Initial_Embodied_water += value
                elif key == 'Glass_Initial_Embodied_water':
                    Glass_Initial_Embodied_water += value
                elif key == 'Sand_stone_ceramics_Initial_Embodied_water':
                    Sand_stone_ceramics_Initial_Embodied_water += value
                elif key == 'Miscellaneous_Initial_Embodied_water':
                    Miscellaneous_Initial_Embodied_water += value
                elif key == 'Metals_Initial_Embodied_water':
                    Metals_Initial_Embodied_water += value
                elif key == 'Plastics_Initial_Embodied_water':
                    Plastics_Initial_Embodied_water += value
                elif key == 'Concrete_plaster_products_Initial_Embodied_water':
                    Concrete_plaster_products_Initial_Embodied_water += value
                # Embodied Energy by Material Categories
                elif key == 'Insulation_Initial_Embodied_energy':
                    Insulation_Initial_Embodied_energy += value
                elif key == 'Timber_Initial_Embodied_energy':
                    Timber_Initial_Embodied_energy += value
                elif key == 'Glass_Initial_Embodied_energy':
                    Glass_Initial_Embodied_energy += value
                elif key == 'Sand_stone_ceramics_Initial_Embodied_energy':
                    Sand_stone_ceramics_Initial_Embodied_energy += value
                elif key == 'Miscellaneous_Initial_Embodied_energy':
                    Miscellaneous_Initial_Embodied_energy += value
                elif key == 'Metals_Initial_Embodied_energy':
                    Metals_Initial_Embodied_energy += value
                elif key == 'Plastics_Initial_Embodied_energy':
                    Plastics_Initial_Embodied_energy += value
                elif key == 'Concrete_plaster_products_Initial_Embodied_energy':
                    Concrete_plaster_products_Initial_Embodied_energy += value
                # Embodied GHG by Material Categories
                elif key == 'Insulation_Initial_Embodied_GHG':
                    Insulation_Initial_Embodied_GHG += value
                elif key == 'Timber_Initial_Embodied_GHG':
                    Timber_Initial_Embodied_GHG += value
                elif key == 'Glass_Initial_Embodied_GHG':
                    Glass_Initial_Embodied_GHG += value
                elif key == 'Sand_stone_ceramics_Initial_Embodied_GHG':
                    Sand_stone_ceramics_Initial_Embodied_GHG += value
                elif key == 'Miscellaneous_Initial_Embodied_GHG':
                    Miscellaneous_Initial_Embodied_GHG += value
                elif key == 'Metals_Initial_Embodied_GHG':
                    Metals_Initial_Embodied_GHG += value
                elif key == 'Plastics_Initial_Embodied_GHG':
                    Plastics_Initial_Embodied_GHG += value
                elif key == 'Concrete_plaster_products_Initial_Embodied_GHG':
                    Concrete_plaster_products_Initial_Embodied_GHG += value
                # Maintenance Embodied Water by Material Categories
                elif key == 'Insulation_Maintenance_Embodied_water':
                    Insulation_Maintenance_Embodied_water += value
                elif key == 'Timber_Maintenance_Embodied_water':
                    Timber_Maintenance_Embodied_water += value
                elif key == 'Glass_Maintenance_Embodied_water':
                    Glass_Maintenance_Embodied_water += value
                elif key == 'Sand_stone_ceramics_Maintenance_Embodied_water':
                    Sand_stone_ceramics_Maintenance_Embodied_water += value
                elif key == 'Miscellaneous_Maintenance_Embodied_water':
                    Miscellaneous_Maintenance_Embodied_water += value
                elif key == 'Metals_Maintenance_Embodied_water':
                    Metals_Maintenance_Embodied_water += value
                elif key == 'Plastics_Maintenance_Embodied_water':
                    Plastics_Maintenance_Embodied_water += value
                elif key == 'Concrete_plaster_products_Maintenance_Embodied_water':
                    Concrete_plaster_products_Maintenance_Embodied_water += value

                # Maintenance Embodied Energy by Material Categories
                elif key == 'Insulation_Maintenance_Embodied_energy':
                    Insulation_Maintenance_Embodied_energy += value
                elif key == 'Timber_Maintenance_Embodied_energy':
                    Timber_Maintenance_Embodied_energy += value
                elif key == 'Glass_Maintenance_Embodied_energy':
                    Glass_Maintenance_Embodied_energy += value
                elif key == 'Sand_stone_ceramics_Maintenance_Embodied_energy':
                    Sand_stone_ceramics_Maintenance_Embodied_energy += value
                elif key == 'Miscellaneous_Maintenance_Embodied_energy':
                    Miscellaneous_Maintenance_Embodied_energy += value
                elif key == 'Metals_Maintenance_Embodied_energy':
                    Metals_Maintenance_Embodied_energy += value
                elif key == 'Plastics_Maintenance_Embodied_energy':
                    Plastics_Maintenance_Embodied_energy += value
                elif key == 'Concrete_plaster_products_Maintenance_Embodied_energy':
                    Concrete_plaster_products_Maintenance_Embodied_energy += value

                # Maintenance Embodied GHG by Material Categories
                elif key == 'Insulation_Maintenance_Embodied_GHG':
                    Insulation_Maintenance_Embodied_GHG += value
                elif key == 'Timber_Maintenance_Embodied_GHG':
                    Timber_Maintenance_Embodied_GHG += value
                elif key == 'Glass_Maintenance_Embodied_GHG':
                    Glass_Maintenance_Embodied_GHG += value
                elif key == 'Sand_stone_ceramics_Maintenance_Embodied_GHG':
                    Sand_stone_ceramics_Maintenance_Embodied_GHG += value
                elif key == 'Miscellaneous_Maintenance_Embodied_GHG':
                    Miscellaneous_Maintenance_Embodied_GHG += value
                elif key == 'Metals_Maintenance_Embodied_GHG':
                    Metals_Maintenance_Embodied_GHG += value
                elif key == 'Plastics_Maintenance_Embodied_GHG':
                    Plastics_Maintenance_Embodied_GHG += value
                elif key == 'Concrete_plaster_products_Maintenance_Embodied_GHG':
                    Concrete_plaster_products_Maintenance_Embodied_GHG += value

        # Apply wastage coefficient and reduction factors to the aggregated values
        def apply_factors(value, reduction_factor):
            return value * (1 - reduction_factor / 100)
        embodied_energy_coefficient = apply_factors(embodied_energy_coefficient, energy_reduction_factor)
        embodied_water_coefficient = apply_factors(embodied_water_coefficient, water_reduction_factor)
        embodied_GHG_coefficient = apply_factors(embodied_GHG_coefficient, ghg_reduction_factor)


        # Generate a final assembly data list
        final_assembly_data_list = [
            ('Name', Name),
            ('embodied_energy_coefficient', embodied_energy_coefficient),
            ('embodied_water_coefficient', embodied_water_coefficient),
            ('embodied_GHG_coefficient', embodied_GHG_coefficient),
            ('operational_energy_coefficient', operational_energy_coefficient),
            ('operational_ghg_coefficient', operational_ghg_coefficient),
            ('operational_water_coefficient', operational_water_coefficient),
            ('maintenance_embodied_energy', maintenance_embodied_energy),
            ('maintenance_embodied_ghg', maintenance_embodied_ghg),
            ('maintenance_embodied_water', maintenance_embodied_water),
            ('mass', mass),
            ('concrete_and_plaster_products', concrete_and_plaster_products),
            ('plastics', plastics),
            ('metals', metals),
            ('miscellaneous', miscellaneous),
            ('sand_stone_ceramics', sand_stone_ceramics),
            ('timber', timber),
            ('glass', glass),
            ('insulation', insulation),
            # Embodied Water by Material Categories
    ('Insulation_Initial_Embodied_water', Insulation_Initial_Embodied_water),
    ('Timber_Initial_Embodied_water', Timber_Initial_Embodied_water),
    ('Glass_Initial_Embodied_water', Glass_Initial_Embodied_water),
    ('Sand_stone_ceramics_Initial_Embodied_water', Sand_stone_ceramics_Initial_Embodied_water),
    ('Miscellaneous_Initial_Embodied_water', Miscellaneous_Initial_Embodied_water),
    ('Metals_Initial_Embodied_water', Metals_Initial_Embodied_water),
    ('Plastics_Initial_Embodied_water', Plastics_Initial_Embodied_water),
    ('Concrete_plaster_products_Initial_Embodied_water', Concrete_plaster_products_Initial_Embodied_water),

    # Embodied Energy by Material Categories
    ('Insulation_Initial_Embodied_energy', Insulation_Initial_Embodied_energy),
    ('Timber_Initial_Embodied_energy', Timber_Initial_Embodied_energy),
    ('Glass_Initial_Embodied_energy', Glass_Initial_Embodied_energy),
    ('Sand_stone_ceramics_Initial_Embodied_energy', Sand_stone_ceramics_Initial_Embodied_energy),
    ('Miscellaneous_Initial_Embodied_energy', Miscellaneous_Initial_Embodied_energy),
    ('Metals_Initial_Embodied_energy', Metals_Initial_Embodied_energy),
    ('Plastics_Initial_Embodied_energy', Plastics_Initial_Embodied_energy),
    ('Concrete_plaster_products_Initial_Embodied_energy', Concrete_plaster_products_Initial_Embodied_energy),

    # Embodied GHG by Material Categories
    ('Insulation_Initial_Embodied_GHG', Insulation_Initial_Embodied_GHG),
    ('Timber_Initial_Embodied_GHG', Timber_Initial_Embodied_GHG),
    ('Glass_Initial_Embodied_GHG', Glass_Initial_Embodied_GHG),
    ('Sand_stone_ceramics_Initial_Embodied_GHG', Sand_stone_ceramics_Initial_Embodied_GHG),
    ('Miscellaneous_Initial_Embodied_GHG', Miscellaneous_Initial_Embodied_GHG),
    ('Metals_Initial_Embodied_GHG', Metals_Initial_Embodied_GHG),
    ('Plastics_Initial_Embodied_GHG', Plastics_Initial_Embodied_GHG),
    ('Concrete_plaster_products_Initial_Embodied_GHG', Concrete_plaster_products_Initial_Embodied_GHG),

    # Maintenance Embodied Water by Material Categories
    ('Insulation_Maintenance_Embodied_water', Insulation_Maintenance_Embodied_water),
    ('Timber_Maintenance_Embodied_water', Timber_Maintenance_Embodied_water),
    ('Glass_Maintenance_Embodied_water', Glass_Maintenance_Embodied_water),
    ('Sand_stone_ceramics_Maintenance_Embodied_water', Sand_stone_ceramics_Maintenance_Embodied_water),
    ('Miscellaneous_Maintenance_Embodied_water', Miscellaneous_Maintenance_Embodied_water),
    ('Metals_Maintenance_Embodied_water', Metals_Maintenance_Embodied_water),
    ('Plastics_Maintenance_Embodied_water', Plastics_Maintenance_Embodied_water),
    ('Concrete_plaster_products_Maintenance_Embodied_water', Concrete_plaster_products_Maintenance_Embodied_water),

    # Maintenance Embodied Energy by Material Categories
    ('Insulation_Maintenance_Embodied_energy', Insulation_Maintenance_Embodied_energy),
    ('Timber_Maintenance_Embodied_energy', Timber_Maintenance_Embodied_energy),
    ('Glass_Maintenance_Embodied_energy', Glass_Maintenance_Embodied_energy),
    ('Sand_stone_ceramics_Maintenance_Embodied_energy', Sand_stone_ceramics_Maintenance_Embodied_energy),
    ('Miscellaneous_Maintenance_Embodied_energy', Miscellaneous_Maintenance_Embodied_energy),
    ('Metals_Maintenance_Embodied_energy', Metals_Maintenance_Embodied_energy),
    ('Plastics_Maintenance_Embodied_energy', Plastics_Maintenance_Embodied_energy),
    ('Concrete_plaster_products_Maintenance_Embodied_energy', Concrete_plaster_products_Maintenance_Embodied_energy),

    # Maintenance Embodied GHG by Material Categories
    ('Insulation_Maintenance_Embodied_GHG', Insulation_Maintenance_Embodied_GHG),
    ('Timber_Maintenance_Embodied_GHG', Timber_Maintenance_Embodied_GHG),
    ('Glass_Maintenance_Embodied_GHG', Glass_Maintenance_Embodied_GHG),
    ('Sand_stone_ceramics_Maintenance_Embodied_GHG', Sand_stone_ceramics_Maintenance_Embodied_GHG),
    ('Miscellaneous_Maintenance_Embodied_GHG', Miscellaneous_Maintenance_Embodied_GHG),
    ('Metals_Maintenance_Embodied_GHG', Metals_Maintenance_Embodied_GHG),
    ('Plastics_Maintenance_Embodied_GHG', Plastics_Maintenance_Embodied_GHG),
    ('Concrete_plaster_products_Maintenance_Embodied_GHG', Concrete_plaster_products_Maintenance_Embodied_GHG),
        ]

        # Return the final values
        return (
            final_assembly_data_list,
    embodied_energy_coefficient, 
    embodied_water_coefficient, 
    embodied_GHG_coefficient,
    operational_energy_coefficient, 
    operational_ghg_coefficient, 
    operational_water_coefficient,
    maintenance_embodied_energy, 
    maintenance_embodied_ghg, 
    maintenance_embodied_water,
    mass, 
    concrete_and_plaster_products, 
    plastics, 
    metals, 
    miscellaneous, 
    sand_stone_ceramics, 
    timber, 
    glass, 
    insulation,
    
    # Embodied Water by Material Categories
    Insulation_Initial_Embodied_water,
    Timber_Initial_Embodied_water,
    Glass_Initial_Embodied_water,
    Sand_stone_ceramics_Initial_Embodied_water,
    Miscellaneous_Initial_Embodied_water,
    Metals_Initial_Embodied_water,
    Plastics_Initial_Embodied_water,
    Concrete_plaster_products_Initial_Embodied_water,

    # Embodied Energy by Material Categories
    Insulation_Initial_Embodied_energy,
    Timber_Initial_Embodied_energy,
    Glass_Initial_Embodied_energy,
    Sand_stone_ceramics_Initial_Embodied_energy,
    Miscellaneous_Initial_Embodied_energy,
    Metals_Initial_Embodied_energy,
    Plastics_Initial_Embodied_energy,
    Concrete_plaster_products_Initial_Embodied_energy,

    # Embodied GHG by Material Categories
    Insulation_Initial_Embodied_GHG,
    Timber_Initial_Embodied_GHG,
    Glass_Initial_Embodied_GHG,
    Sand_stone_ceramics_Initial_Embodied_GHG,
    Miscellaneous_Initial_Embodied_GHG,
    Metals_Initial_Embodied_GHG,
    Plastics_Initial_Embodied_GHG,
    Concrete_plaster_products_Initial_Embodied_GHG,

    # Maintenance Embodied Water by Material Categories
    Insulation_Maintenance_Embodied_water,
    Timber_Maintenance_Embodied_water,
    Glass_Maintenance_Embodied_water,
    Sand_stone_ceramics_Maintenance_Embodied_water,
    Miscellaneous_Maintenance_Embodied_water,
    Metals_Maintenance_Embodied_water,
    Plastics_Maintenance_Embodied_water,
    Concrete_plaster_products_Maintenance_Embodied_water,

    # Maintenance Embodied Energy by Material Categories
    Insulation_Maintenance_Embodied_energy,
    Timber_Maintenance_Embodied_energy,
    Glass_Maintenance_Embodied_energy,
    Sand_stone_ceramics_Maintenance_Embodied_energy,
    Miscellaneous_Maintenance_Embodied_energy,
    Metals_Maintenance_Embodied_energy,
    Plastics_Maintenance_Embodied_energy,
    Concrete_plaster_products_Maintenance_Embodied_energy,

    # Maintenance Embodied GHG by Material Categories
    Insulation_Maintenance_Embodied_GHG,
    Timber_Maintenance_Embodied_GHG,
    Glass_Maintenance_Embodied_GHG,
    Sand_stone_ceramics_Maintenance_Embodied_GHG,
    Miscellaneous_Maintenance_Embodied_GHG,
    Metals_Maintenance_Embodied_GHG,
    Plastics_Maintenance_Embodied_GHG,
    Concrete_plaster_products_Maintenance_Embodied_GHG
        )
# ---------- end infraset_element_3 ----------
panel_6 = Panel(infraset_element_3.final_assembly_data_list)

path = FilePath("C:\Users\ataee\OneDrive - UCL\Images\New folder\")
result = Text("Final")
# Infraset_Custom component (Embodied flows)
# Excel file
python = GhPythonScript(data=reverse(panel_6), path=path, name=result)  # -> a
# ---------- python: Python ----------
from ghpythonlib.componentbase import executingcomponent as component
import csv
import os
import codecs  # Import the codecs module for encoding compatibility

class MyComponent(component):
    
    def RunScript(self, input_data, file_path, file_name):
        """Processes input data containing multiple key-value pairs and writes them to a CSV file.
        
        Inputs:
            input_data: The input text containing data to be processed.
            file_path: The path to save the CSV file.
            file_name: The name of the CSV file to save.
            
        Output:
            a: A success message indicating where the CSV was saved or an error message if there was a problem.
        """
        
        __author__ = "AdminTMP"
        __version__ = "2024.12.05"

        # Step 1: Process the input data to extract key-value pairs
        lines = input_data.strip().splitlines()
        data = []

        # Skip lines starting with '{' and any empty lines
        for line in lines:
            if line.strip().startswith("{") or not line.strip():
                continue

            # Try to extract key-value pairs from each line
            try:
                # Split on the first occurrence of a number followed by '. ' (e.g., '1. ')
                line = line.split(". ", 1)[-1]
                key_value = eval(line)  # Safely evaluate the tuple

                # Ensure the key is a string and convert the value to string if needed
                if isinstance(key_value, tuple) and len(key_value) == 2:
                    key, value = key_value
                    if isinstance(key, str) and not isinstance(value, str):
                        value = str(value)  # Convert non-string values to strings
                    data.append([key, value])
                else:
                    raise ValueError("Invalid format for key-value pair")
            except (SyntaxError, ValueError) as e:
                return "An error occurred while processing line '{}': {}".format(line, str(e))

        # Step 2: Write data to a CSV file
        output_path = os.path.join(file_path, "{}.csv".format(file_name))  # Cross-platform path construction

        try:
            # Use codecs to open the file with encoding for Python 2.x compatibility
            with codecs.open(output_path, mode="w", encoding='utf-8') as file:
                writer = csv.writer(file)
                writer.writerow(["Key", "Value"])  # Write header row
                writer.writerows(data)  # Write data rows

            return "CSV file saved successfully at: {}".format(output_path)
        except Exception as e:
            return "An error occurred while saving the CSV file: {}".format(str(e))
# ---------- end python ----------
# Infraset_Element (Moreland station)
# Infraset_Element (Coburg station)
panel_7 = Panel(python)
